# Grasshopper definition ConnectToServer.gh (Grasshopper 1.0.5)

button = Button()
c_script = CSharpScript(Reference="C:\Users\epoulsen\Documents\GitHub\GrasshopperLive\src\csharp\GrasshopperLive.Core\bin\Debug\GrasshopperLive.Core.dll")  # -> out, A; inputs x: Boolean
# ---------- c_script: C# ----------
    if(x)
    {
      GrasshopperLive.GrasshopperLive ghLive = new GrasshopperLive.GrasshopperLive();
      
      ghLive.Connect();
    }
# ---------- end c_script ----------
