# Grasshopper definition ConnectToServer_Paul2.gh (Grasshopper 1.0.5)

# ---- group: Document Events
c_script = CSharpScript(x=Toggle(False))  # -> out, A, B, C, D, E
# ---------- c_script: C# ----------
    Print("Document Name: " + GrasshopperDocument.DisplayName);

    // string name = "Charlie";
    // GrasshopperDocument.ObjectsAdded += GrasshopperDocument.ObjectsAddedEventHandler;

    // subscribe to OnObjects Added
    GrasshopperDocument.ObjectsAdded += ObjectsAddedEvent;

    GrasshopperDocument.OnObjectsAdded(GrasshopperDocument.Objects);

    // unsubscribe to OnObjects Added
    GrasshopperDocument.ObjectsAdded -= ObjectsAddedEvent;

    //
    GrasshopperDocument.ModifiedChanged += ModifiedEvent;
    GrasshopperDocument.OnModifiedChanged();
    GrasshopperDocument.ModifiedChanged -= ModifiedEvent;

    //GrasshopperDocument.ObjectsAdded();
# ---------- c_script: C# additional code ----------
  void ObjectsAddedEvent (object sender, EventArgs e){
    Print("Sender: {0} | EventArgs: {1}", sender.GetType().ToString(), e.GetType().ToString());

    Grasshopper.Kernel.GH_Document doc = (Grasshopper.Kernel.GH_Document) sender;
    Grasshopper.Kernel.GH_DocObjectEventArgs args = (Grasshopper.Kernel.GH_DocObjectEventArgs) e;

    Print("Number of objects on canvas: " + args.ObjectCount.ToString());
    Print("Object type: " + args.Objects[args.ObjectCount - 1].GetType().ToString());
    Print(args.Objects[args.ObjectCount - 1].Name);

    try{
      var obj = args.Objects[args.ObjectCount - 1];
      Grasshopper.Kernel.GH_Component comp = (Grasshopper.Kernel.GH_Component) obj;
      //Print("Location: {0} | {1}", comp.Attributes..Attributes.Pivot.X.ToString(), comp2.Attributes.Pivot.Y.ToString());

      IGH_Component comp2 = (IGH_Component) obj;
      Print("Location2: {0} | {1}", comp2.Attributes.Pivot.X.ToString(), comp2.Attributes.Pivot.Y.ToString());
      Print("Component ID: " + comp2.ComponentGuid.ToString());
    } catch (Exception ex){
      Print(ex.Message);
    }

    GrasshopperDocument.ExpireSolution();
  }


  void ModifiedEvent(object sender, EventArgs e){
    Print("Sender: {0} | EventArgs: {1}", sender.GetType().ToString(), e.GetType().ToString());

    Grasshopper.Kernel.GH_Document doc = (Grasshopper.Kernel.GH_Document) sender;
    Grasshopper.Kernel.GH_DocModifiedEventArgs args = (Grasshopper.Kernel.GH_DocModifiedEventArgs) e;

    Print("Document Modified: " + args.Modified);
  }
# ---------- end c_script ----------
panel = Panel(c_script.out)
panel_2 = Panel(c_script.A)

# ----
c_script_2 = CSharpScript(
    x=Button(),
    Reference=["C:\Users\epoulsen\Documents\GitHub\GrasshopperLive\src\csharp\GrasshopperLive.Core\bin\Debug\GrasshopperLive.Core.dll", "C:\Program Files\Rhino 6\Plug-ins\Grasshopper\Components\CurveComponents.gha"])  # -> out, A; inputs x: Boolean
# ---------- c_script_2: C# ----------
    if(x)
    {
      if(!subscribed)
      {
        GrasshopperDocument.ObjectsAdded += ObjectsAddedEvent;
        subscribed = true;
      }

      //GrasshopperDocument.OnObjectsAdded(GrasshopperDocument.Objects);


      GrasshopperLive.GrasshopperLive ghLive;
      ghLive = new GrasshopperLive.GrasshopperLive();
      ghLive.DataReceived += GhLive_DataReceived;
      ghLive.Connect();
      _id = ghLive.SocketId;
      _log.Add("senderId: " + _id);
      _ghLive = ghLive;
    }
    A = _log;
# ---------- c_script_2: C# additional code ----------
  public void AddItem(string item)
  {
    _log.Insert(0, item);
  }

  bool subscribed = false;
  List<string> _log = new List<string>();
  string _id;
  GrasshopperLive.GrasshopperLive _ghLive;

  void ObjectsAddedEvent (object sender, EventArgs e){


    Grasshopper.Kernel.GH_Document doc = (Grasshopper.Kernel.GH_Document) sender;
    Grasshopper.Kernel.GH_DocObjectEventArgs args = (Grasshopper.Kernel.GH_DocObjectEventArgs) e;

    try{
      var obj = args.Objects[args.ObjectCount - 1];
      Grasshopper.Kernel.GH_Component comp = (Grasshopper.Kernel.GH_Component) obj;
      var addedGuid = comp.InstanceGuid;

      if(addedGuid == _lastAdded) return;
      if(_ghLive == null) return;
      string addedMsg = "object added event: " + addedGuid.ToString();

      AddItem(addedMsg);

      double x = comp.Attributes.Pivot.X;
      double y = comp.Attributes.Pivot.Y;

      var type = comp.GetType().ToString();

      GhLivePoint pt = new GhLivePoint();
      pt.X = x;
      pt.Y = y;

      //_ghLive.SendChatMessage(addedMsg);
      //SendAddUpdateMessage(Guid componentId, Guid customId, GhLivePoint position)
      _ghLive.SendAddUpdateMessage(type, Guid.Empty, pt);
      //_ghLive.SendChatMessage(string.Format("X:{0} Y:{1}", x, y));

    } catch (Exception ex){
      //Print(ex.Message);
    }



    GrasshopperDocument.ExpireSolution();
  }


  Guid _lastAdded;
  private void GhLive_DataReceived(object sender, GhLiveEventArgs e)
  {
    AddItem("sender:  " + e.TheObject.Sender + " " + e.TheObject.Message);
    if(e.TheObject.Sender == _id){
      _log.Add("not creating a component!");
      return;
    }

    if(e.TheObject.UpdateType == UpdateType.Add)
    {
      AddComponent((float) e.TheObject.Point.X, (float) e.TheObject.Point.Y);
    }

    Grasshopper.Instances.DocumentEditor.BeginInvoke(new Action(() => { Component.ExpireSolution(true); }));

  }

  public void AddComponent(float x, float y)
  {


    //System.Windows.Forms.MessageBox.Show(e.TheObject.Message);

    //_messageLog.Add(e.TheObject.Message);
    //Grasshopper.Instances.DocumentEditor. //BeginInvoke(new Action(() => { GH_JoinSession.Application.ExpireSolution(true); }));
    //GH_JoinSession.Application.ExpireSolution(true);
    //_log.Add();
    //_log.Add("WOW!");


    //------------------


    CurveComponents.Component_CircleCNR cs = new CurveComponents.Component_CircleCNR();

    cs.CreateAttributes();
    cs.Attributes.Pivot = new System.Drawing.PointF(x, y);

    GH_Document doc = Grasshopper.Instances.ActiveCanvas.Document;
    IList<IGH_DocumentObject> documentObjects = doc.Objects;
    _lastAdded = cs.InstanceGuid;

    bool IsAdded = doc.AddObject(cs, false, 1);

    //------------------

    //Component.ExpireSolution(true);
    //Component.ExpireSolution(true);
    //GrasshopperDocument.NewSolution(true);

    //Grasshopper.GUI.Canvas.GH_Canvas canvas = Grasshopper.Instances.ActiveCanvas;

  }
# ---------- end c_script_2 ----------
panel_3 = Panel(c_script_2.A)
