# Grasshopper definition Looking_Into_GH_Doc_Events_01.gh (Grasshopper 1.0.7)

# ---- group: Document Events
c_script = CSharpScript(x=Toggle(False))  # -> out, A, B, C, D, E
# ---------- c_script: C# ----------
    Print("Document Name: " + GrasshopperDocument.DisplayName);

    // string name = "Charlie";
    // GrasshopperDocument.ObjectsAdded += GrasshopperDocument.ObjectsAddedEventHandler;

    GrasshopperDocument.ObjectsAdded += ObjectsAddedEvent;
    GrasshopperDocument.OnObjectsAdded(GrasshopperDocument.Objects);
    GrasshopperDocument.ObjectsAdded -= ObjectsAddedEvent;

    GrasshopperDocument.ModifiedChanged += ModifiedEvent;
    GrasshopperDocument.OnModifiedChanged();
    GrasshopperDocument.ModifiedChanged -= ModifiedEvent;
    
    //GrasshopperDocument.ObjectsAdded();
# ---------- c_script: C# additional code ----------
  void ObjectsAddedEvent (object sender, EventArgs e){
    Print(sender.GetType().ToString());
    Print(e.GetType().ToString());

    Grasshopper.Kernel.GH_Document doc = (Grasshopper.Kernel.GH_Document) sender;
    Grasshopper.Kernel.GH_DocObjectEventArgs args = (Grasshopper.Kernel.GH_DocObjectEventArgs) e;

    Print("Number of objects on canvas: " + args.ObjectCount.ToString());
  }


  void ModifiedEvent(object sender, EventArgs e){
    Print(sender.GetType().ToString());
    Print(e.GetType().ToString());

    Grasshopper.Kernel.GH_Document doc = (Grasshopper.Kernel.GH_Document) sender;
    Grasshopper.Kernel.GH_DocModifiedEventArgs args = (Grasshopper.Kernel.GH_DocModifiedEventArgs) e;

    Print("Document Modified: " + args.Modified);
  }
# ---------- end c_script ----------
panel = Panel(c_script.out)
panel_2 = Panel(c_script.A)

# ----
c_script_2 = CSharpScript()  # -> out, A, B, C, D, E
# ---------- c_script_2: C# ----------
    // A = Grasshopper.GUI.Canvas.GH_Canvas.;

    GrasshopperDocument.ObjectsAdded += ObjectsAddedEvent;
    GrasshopperDocument.ObjectsAdded -= ObjectsAddedEvent;
 
    // Grasshopper.GUI.Canvas.GH_Canvas.Document_ObjectsAddedEventHandler
    // Grasshopper.GUI.Canvas.GH_Canvas.Document_ModifiedChangedEventHandler
# ---------- c_script_2: C# additional code ----------
  void ObjectsAddedEvent(object sender, EventArgs e){
    Print(sender.GetType().ToString());
    Print(e.GetType().ToString());

  }

  //public void AddedToDocument(GH_Document document) {
  //  base.AddedToDocument(document);
  // }
# ---------- end c_script_2 ----------
panel_3 = Panel(c_script_2.out)
panel_4 = Panel(c_script_2.A)
